# Dynamo graph Sheets-Issuance-Schedule.dyn (Dynamo 3.3.0.6316)

# group: Parameters
n01_param_group_assignment_in = StringInput("Graphics")  # "01.Param group assignment in proerties"; graph input
n02_revision_param_prefix = StringInput("REV")  # "02.Revision param prefix"; graph input
n03_make_params_non_user = BoolSelector(false)  # "03.Make Params Non-User-Modifyable"
py_revparams = Python()  # "py.RevParams-WriteSharedParamFile.py"; CPython3
# ---------- py_revparams.python (107 lines) ----------
# [py.Revisions-InProject-Data.py]
# V00-00-2026-01-30t1402p
# encoding: utf-8
# Purpose and IO:
#   Purpose:
#     Collect project Revisions and output a stable, schedule-friendly payload
#     for downstream nodes (shared-param writer / binder / stamper / scheduler).
#
#   IN:
#     None
#
#   OUT:
#     OUT[0]=revisionsData (list[dict]) with keys:
#       - Id (int)
#       - SequenceNumber (int)
#       - RevisionNumber (string)
#       - RevisionDate (string)
#       - Description (string)

import clr

#####################################
## 0000_Revit-Imports-And-Context()
#####################################
clr.AddReference("RevitServices")
from RevitServices.Persistence import DocumentManager

clr.AddReference("RevitAPI")
from Autodesk.Revit.DB import FilteredElementCollector, Revision

doc = DocumentManager.Instance.CurrentDBDocument

#####################################
## 0100_Utilities()
#####################################
def safe_str(x):
    """Defensive string conversion for Revit/Dynamo types."""
    try:
        return "" if x is None else str(x)
    except:
        return ""

def safe_int(x, default=0):
    """Defensive int conversion."""
    try:
        return int(x)
    except:
        return int(default)

#####################################
## 0200_Get-RevisionsData()
#####################################
def get_revisions_data(doc_):
    """
    Returns list[dict] ordered by SequenceNumber (stable).
    Keys match downstream nodes: Id, SequenceNumber, RevisionNumber, RevisionDate, Description.
    """
    items = []
    revs = list(FilteredElementCollector(doc_).OfClass(Revision).ToElements())

    for r in revs:
        try:
            rid = r.Id.IntegerValue
        except:
            continue

        try:
            seq = safe_int(getattr(r, "SequenceNumber", 10**9), 10**9)
        except:
            seq = 10**9

        try:
            rev_num = safe_str(getattr(r, "RevisionNumber", ""))
        except:
            rev_num = ""

        try:
            rev_date = safe_str(getattr(r, "RevisionDate", ""))
        except:
            rev_date = ""

        try:
            desc = safe_str(getattr(r, "Description", ""))
        except:
            desc = ""

        items.append({
            "Id": rid,
            "SequenceNumber": seq,
            "RevisionNumber": rev_num,
            "RevisionDate": rev_date,
            "Description": desc,
        })

    try:
        items.sort(key=lambda d: safe_int(d.get("SequenceNumber", 10**9), 10**9))
    except:
        pass

    return items

#####################################
## 0900_Main()
#####################################
revisions_data = get_revisions_data(doc)

OUT = [revisions_data]
# ----------------------------------------

py_revparams_2 = Python(IN[0]=n01_param_group_assignment_in, IN[1]=n02_revision_param_prefix, IN[2]=n03_make_params_non_user, IN[3]=py_revparams)  # "py.RevParams-WriteSharedParamFile.py"; CPython3
# ---------- py_revparams_2.python (560 lines) ----------
# [py.RevParams-WriteSharedParamFile.py]
# V00-07-2026-02-01t1519p
# encoding: utf-8
# Purpose and IO:
#   Manual inputs:
#     IN[0]=ParamGroupAssignment (string)                     # stored for downstream (this node does NOT load/bind)
#     IN[1]=RevisionParamPrefix (string) default "REV."       # used as literal prefix in ParamName
#     IN[2]=MakeParamsNonUserModifiable (bool) default False  # written into USERMODIFIABLE column for NEW params AND UPDATED existing params
#     IN[3]=revisionsData (list[dict]) from py.Revisions-InProject-Data.py OUT[0]
#
#   Behavior (NO Revit API loading/binding here):
#     0) Shared parameter file path is STABLE per-model:
#          %TEMP%\Revisions_<ModelName>.txt
#     1) Build canonical ParamName (FORCE 6-bit) per revision:
#          ParamName := {RevPrefix}{yyyymmdd}{snippet}
#          - max ParamName length for forced 6-bit encoder is 21 chars
#     2) Deterministic GUID is computed from ParamName (FORCE 6-bit, VBA-compatible charset)
#        - Characters NOT in the charset are substituted with '.' (index 0)
#     3) If file exists: PARSE existing PARAM rows and UPSERT by GUID:
#        - If GUID exists -> UPDATE row fields:
#            NAME, VISIBLE=1, DESCRIPTION (tooltip), USERMODIFIABLE
#        - If GUID missing -> APPEND new PARAM row
#     4) DESCRIPTION (tooltip) := full revision name (long form)
#     5) Output file path + packets for downstream node(s) (do not load yet)
#
#   OUT=list:
#     OUT[0]=SharedParamFilePath (string)
#     OUT[1]=ParamNames (list[string])                 # canonical names used for CURRENT revisions
#     OUT[2]=RevIdToParam (dict[str,str])              # revision id -> canonical param name
#     OUT[3]=Report (dict)
#     OUT[4]=ParamPacket (list[dict])                  # revision + param + guid bundle (CURRENT revisions)
#     OUT[5]=ParamNameToGuid (dict[str,str])           # canonical param name -> guid (CURRENT revisions)

import os
import re
import tempfile
from datetime import datetime

import clr
clr.AddReference("RevitServices")
from RevitServices.Persistence import DocumentManager

#####################################
## 0000_Constants()
#####################################
BASE_ALL = r""".1234ABCDEFGHIJKLMNOPQRSTUVWXYZ_abcdefghijklmnopqrstuvwxyz056789!\"#$%&'()*+,-./:;<=>?@[\]^`{|}~"""

DISCLAIMER = (
    "# Patent Pending: Deterministic reversible GUID encoding system\n"
    "# Inventor: Ron E. Allen\n"
    "# ©2026 Ron E. Allen - all rights reserved.\n"
)

GROUP_NAME_IN_FILE = "DynamoProjectLocal"

# Forced 6-bit => max length = floor(128/6) = 21
MAX_LEN_6BIT = int(128 / 6)  # 21

#####################################
## 0100_String-Helpers()
#####################################
def safe_str(x):
    """Comment: defensive string conversion."""
    try:
        return "" if x is None else str(x)
    except:
        return ""

def pad2(num_str):
    """Comment: 2-digit revision number formatting (best effort)."""
    try:
        n = int(str(num_str).strip())
        return "{:02d}".format(n)
    except:
        s = safe_str(num_str).strip()
        if len(s) >= 2:
            return s
        return ("0" + s) if s else "00"

def sanitize_for_param_name(name):
    """
    Comment: sanitize input for a Revit parameter name (NOT the compression).
    Keeps it readable and stable for downstream.
    """
    name = safe_str(name)
    for b in ["\n", "\r", "\t"]:
        name = name.replace(b, " ")
    name = " ".join(name.split())
    for ch in ["{", "}", "[", "]", "<", ">", "|", ";"]:
        name = name.replace(ch, "")
    return name.strip()

def sanitize_filename(name):
    """Comment: make a safe Windows filename stem."""
    s = safe_str(name).strip()
    if not s:
        return "UnnamedModel"
    s = re.sub(r"[\\/:*?\"<>|]+", "_", s)
    s = re.sub(r"\s+", "_", s)
    s = s.strip("._ ")
    return s if s else "UnnamedModel"

#####################################
## 0150_Normalize-Inputs()
#####################################
def normalize_revisions_data(obj):
    """
    Comment: accept list[dict] or wrapped [[dict..]] and return list[dict].
    """
    if obj is None:
        return []
    if isinstance(obj, list):
        if len(obj) == 0:
            return []
        if isinstance(obj[0], dict):
            return obj
        if isinstance(obj[0], list) and obj[0] and isinstance(obj[0][0], dict):
            return obj[0]
    return []

#####################################
## 0200_Date-Normalization(yyyymmdd)
#####################################
def to_yyyymmdd(date_str):
    """
    Comment: best-effort convert RevisionDate to yyyymmdd.
    Accepts common formats:
      - YYYY-MM-DD / YYYY/MM/DD
      - MM/DD/YYYY
      - digits-only (tries yyyyMMdd, else mmddyyyy)
    Fallback: "00000000"
    """
    s = safe_str(date_str).strip()
    if not s:
        return "00000000"

    m = re.match(r"^\s*(\d{4})[-/](\d{1,2})[-/](\d{1,2})\s*$", s)
    if m:
        y = m.group(1)
        mo = "{:02d}".format(int(m.group(2)))
        d = "{:02d}".format(int(m.group(3)))
        return "{}{}{}".format(y, mo, d)

    m = re.match(r"^\s*(\d{1,2})[-/](\d{1,2})[-/](\d{4})\s*$", s)
    if m:
        mo = "{:02d}".format(int(m.group(1)))
        d = "{:02d}".format(int(m.group(2)))
        y = m.group(3)
        return "{}{}{}".format(y, mo, d)

    digits = re.sub(r"\D+", "", s)
    if len(digits) >= 8:
        digits = digits[:8]
        if digits.startswith("19") or digits.startswith("20"):
            return digits
        mm = digits[0:2]
        dd = digits[2:4]
        yy = digits[4:8]
        if yy.startswith("19") or yy.startswith("20"):
            return "{}{}{}".format(yy, mm, dd)

    return "00000000"

#####################################
## 0300_Snippet-Compression(~10 chars)
#####################################
def compress_desc_to_snippet(desc):
    """
    Comment: compress Description into alnum-only (A-Z0-9), removing separators.
    We upper-case to stabilize output and avoid locale casing surprises.
    """
    s = sanitize_for_param_name(desc).upper()
    s = re.sub(r"[^A-Z0-9]+", "", s)
    return s or "X"

def build_canonical_param_name(prefix, yyyymmdd, desc, max_len=MAX_LEN_6BIT, desired_snip=10):
    """
    Comment: canonical ParamName := {prefix}{yyyymmdd}{snippet}
    Ensures total length <= 21 for forced 6-bit encoding.
    """
    pfx = safe_str(prefix)
    base = "{}{}".format(pfx, yyyymmdd)
    remaining = max_len - len(base)
    if remaining <= 0:
        return base[:max_len]

    snippet = compress_desc_to_snippet(desc)
    snip_len = min(desired_snip, remaining)
    return (base + snippet[:snip_len])[:max_len]

#####################################
## 0400_Deterministic-GUID(VBA-Compatible, FORCE 6-bit)
#####################################
def _dec2bin(n, bits):
    """Comment: decimal -> fixed-width binary."""
    n = int(n)
    s = ""
    while n != 0:
        s = str(n % 2) + s
        n //= 2
    return (("0" * bits) + s)[-bits:]

def _bin2dec(bs):
    """Comment: binary string -> int."""
    res = 0
    for i in range(len(bs)):
        res += int(bs[-1 - i]) * (2 ** i)
    return res

def guid_encode_from_name_force6(var_name):
    """
    Comment: VBA-compatible deterministic GUID encoding (FORCED 6-bit).
    Illegal chars are substituted with '.' because idx=0 -> BASE_ALL[0] == '.'
    Returns: (guid_str, bit_size, name_used_for_guid)
    """
    sname = (var_name or "").strip()
    bit_size = 6

    max_len = int(128 / bit_size)  # 21
    sname = sname[:max_len]

    bin_string = ""
    for ch in sname:
        idx = BASE_ALL.find(ch)
        if idx < 0 or idx >= (2 ** bit_size):
            idx = 0
        bin_string += _dec2bin(idx, bit_size)

    bin_string += "0" * 128
    bin_string = bin_string[:127] + "1"  # forced 6-bit -> last bit = 1

    hex32 = ""
    while len(bin_string) > 0:
        byte_val = _bin2dec(bin_string[:8])
        hex32 += ("0" + format(byte_val, "X"))[-2:]
        bin_string = bin_string[8:]

    # ensure last nibble LSB set to 1
    last = int(hex32[-1], 16)
    last = (last & 0xE) | 1
    hex32 = hex32[:-1] + format(last, "X")

    guid_str = "{}-{}-{}-{}-{}".format(hex32[:8], hex32[8:12], hex32[12:16], hex32[16:20], hex32[20:32])

    return guid_str.upper(), bit_size, sname

#####################################
## 0500_File-Path(Stable-Per-Model)
#####################################
def get_model_based_sharedparam_path():
    """
    Comment: Stable shared parameter file path per model.
    Uses doc.PathName if available; else doc.Title.
    """
    doc = DocumentManager.Instance.CurrentDBDocument
    model_name = ""
    try:
        pn = safe_str(getattr(doc, "PathName", ""))
        if pn and pn.strip():
            model_name = os.path.splitext(os.path.basename(pn))[0]
    except:
        model_name = ""

    if not model_name:
        try:
            model_name = safe_str(getattr(doc, "Title", "")) or "UnnamedModel"
        except:
            model_name = "UnnamedModel"

    stem = sanitize_filename(model_name)
    td = tempfile.gettempdir()
    return os.path.join(td, "Revisions_{}.txt".format(stem)), stem

#####################################
## 0600_Read-Existing-File-And-Upsert()
#####################################
def parse_existing_guids_and_header(lines):
    """
    Comment: Parse existing PARAM GUIDs.
    Returns: (guid_set_upper, has_param_header)
    """
    guid_set = set()
    has_param_header = False

    for ln in lines:
        s = ln.rstrip("\n\r")
        if s.startswith("*PARAM"):
            has_param_header = True
        if s.startswith("PARAM\t"):
            parts = s.split("\t")
            if len(parts) >= 3:
                g = safe_str(parts[1]).strip().upper()
                if g:
                    guid_set.add(g)
    return guid_set, has_param_header

def build_new_file_header(group_name):
    """Comment: create a clean Revit shared parameter file header with disclaimer."""
    out = []
    out.append("# This is a Revit shared parameter file.")
    for ln in DISCLAIMER.splitlines():
        out.append(ln)
    out.extend([
        "*META\tVERSION\tMINVERSION",
        "META\t2\t1",
        "*GROUP\tID\tNAME",
        "GROUP\t1\t{}".format(group_name),
        "*PARAM\tGUID\tNAME\tDATATYPE\tDATACATEGORY\tGROUP\tVISIBLE\tDESCRIPTION\tUSERMODIFIABLE",
    ])
    return out

def build_param_line(guid, pname, tooltip, non_user_modifiable):
    """Comment: build a single PARAM row."""
    user_mod = "0" if bool(non_user_modifiable) else "1"
    tip = safe_str(tooltip).replace("\t", " ")
    return "PARAM\t{}\t{}\tTEXT\t\t1\t1\t{}\t{}".format(guid, pname, tip, user_mod)

def parse_param_rows(lines):
    """
    Comment: build a GUID->(rowIndex, parts) map for existing PARAM rows.
    Expected parts:
      0=PARAM,1=GUID,2=NAME,3=DATATYPE,4=DATACATEGORY,5=GROUP,6=VISIBLE,7=DESCRIPTION,8=USERMODIFIABLE
    """
    guid_to_row = {}
    for i, ln in enumerate(lines):
        s = safe_str(ln).rstrip("\n\r")
        if not s.startswith("PARAM\t"):
            continue
        parts = s.split("\t")
        if len(parts) < 9:
            continue
        g = safe_str(parts[1]).strip().upper()
        if g:
            guid_to_row[g] = (i, parts)
    return guid_to_row

def upsert_param_row(lines, guid_to_row, guid, pname, tooltip, non_user_modifiable):
    """
    Comment:
      If GUID exists -> UPDATE row: NAME, VISIBLE=1, DESCRIPTION, USERMODIFIABLE.
      If GUID missing -> APPEND new row.
    Returns: "added" | "updated" | "unchanged"
    """
    g = safe_str(guid).strip().upper()
    n = safe_str(pname).strip()
    tip = safe_str(tooltip).replace("\t", " ").strip()
    desired_user_mod = "0" if bool(non_user_modifiable) else "1"

    if g in guid_to_row:
        row_i, parts = guid_to_row[g]
        while len(parts) < 9:
            parts.append("")

        changed = False

        if safe_str(parts[2]) != n:
            parts[2] = n
            changed = True

        if safe_str(parts[6]) != "1":
            parts[6] = "1"
            changed = True

        if safe_str(parts[7]) != tip:
            parts[7] = tip
            changed = True

        if safe_str(parts[8]) != desired_user_mod:
            parts[8] = desired_user_mod
            changed = True

        if changed:
            lines[row_i] = "\t".join(parts)
            guid_to_row[g] = (row_i, parts)
            return "updated"
        return "unchanged"

    lines.append(build_param_line(g, n, tip, non_user_modifiable))
    guid_to_row[g] = (len(lines) - 1, lines[-1].split("\t"))
    return "added"

def safe_write_lines(path, lines):
    """
    Comment: write lines to path.
    If locked, write to an alternate file and return that path.
    """
    text = "\n".join(lines)
    try:
        with open(path, "w") as f:
            f.write(text)
        return path, None
    except Exception as ex:
        base, ext = os.path.splitext(path)
        for i in range(1, 50):
            alt = "{}_ALT{:02d}{}".format(base, i, ext)
            try:
                with open(alt, "w") as f:
                    f.write(text)
                return alt, "Primary file locked; wrote ALT instead: {}".format(safe_str(ex))
            except:
                continue
        return path, "Failed to write file (locked?): {}".format(safe_str(ex))

#####################################
## 0900_Main()
#####################################
param_group_assignment = IN[0] if IN and len(IN) > 0 and IN[0] is not None else "Text"
rev_prefix = IN[1] if IN and len(IN) > 1 and IN[1] else "REV."
make_num = IN[2] if IN and len(IN) > 2 and IN[2] is not None else False
raw_revisions = IN[3] if IN and len(IN) > 3 else None

revisions_data = normalize_revisions_data(raw_revisions)

notes = []
report = {
    "RuntimeStamp": datetime.now().strftime("%Y-%m-%dT%H:%M:%S"),
    "ParamGroupAssignment_Input": safe_str(param_group_assignment),
    "RevPrefix": safe_str(rev_prefix),
    "MakeNonUserModifiable": bool(make_num),
    "GroupNameInFile": GROUP_NAME_IN_FILE,
    "MaxNameLen_6bit": MAX_LEN_6BIT,
    "RevisionsData_Count": len(revisions_data),
}

sp_path, model_stem = get_model_based_sharedparam_path()
report["ModelStem"] = model_stem
report["SharedParamFilePath"] = sp_path

try:
    revs_sorted = sorted(revisions_data, key=lambda r: int(r.get("SequenceNumber", 10**9)))
except:
    revs_sorted = list(revisions_data)
    notes.append("Warning: revisionsData sort by SequenceNumber failed; using input order.")

param_packet = []
param_names = []
rev_id_to_param = {}
param_name_to_guid = {}

for r in revs_sorted:
    if not isinstance(r, dict):
        continue

    rid = r.get("Id", None)
    if rid is None:
        continue
    try:
        rid_int = int(rid)
    except:
        continue

    seq = r.get("SequenceNumber", 10**9)
    rev_num = safe_str(r.get("RevisionNumber", ""))
    rev_date_raw = safe_str(r.get("RevisionDate", ""))
    desc_raw = safe_str(r.get("Description", ""))

    yyyymmdd = to_yyyymmdd(rev_date_raw)
    pname = build_canonical_param_name(rev_prefix, yyyymmdd, desc_raw, max_len=MAX_LEN_6BIT, desired_snip=10)

    full_tip = sanitize_for_param_name("{}{}.{}.{}".format(
        safe_str(rev_prefix),
        pad2(rev_num),
        rev_date_raw,
        desc_raw
    ))

    guid, bit_size, name_used_for_guid = guid_encode_from_name_force6(pname)

    row = {
        "RevisionId": str(rid_int),
        "SequenceNumber": int(seq) if safe_str(seq).strip() else int(10**9),
        "RevisionNumber": rev_num,
        "RevisionDate": rev_date_raw,
        "Description": desc_raw,
        "ParamName": str(pname),
        "ParamGuid": str(guid),
        "BitSize": int(bit_size),
        "NameUsedForGuid": str(name_used_for_guid),
        "ParamTip": str(full_tip),
        "YYYYMMDD": str(yyyymmdd),
        "UserModifiableDesired": (False if bool(make_num) else True),
    }

    param_packet.append(row)
    param_names.append(str(pname))
    rev_id_to_param[rid_int] = str(pname)
    param_name_to_guid[str(pname)] = str(guid)

param_names_out = [str(x) for x in param_names]
rev_id_to_param_out = {str(k): str(v) for k, v in rev_id_to_param.items()}

report["ParamCount_CurrentRevs"] = len(param_names_out)

existing_lines = []
file_existed = os.path.exists(sp_path)
report["FileExisted"] = bool(file_existed)

if file_existed:
    try:
        with open(sp_path, "r") as f:
            existing_lines = f.read().splitlines()
    except Exception as ex:
        existing_lines = []
        notes.append("Warning: failed reading existing file; will rebuild header. {}".format(safe_str(ex)))

existing_guid_set, has_param_header = parse_existing_guids_and_header(existing_lines)
report["ExistingGuidCount"] = len(existing_guid_set)
report["ExistingHasParamHeader"] = bool(has_param_header)

if (not file_existed) or (not has_param_header) or (len(existing_lines) < 5):
    lines_out = build_new_file_header(GROUP_NAME_IN_FILE)
    report["HeaderMode"] = "RebuiltHeader"
else:
    lines_out = list(existing_lines)
    report["HeaderMode"] = "PreservedExisting"

guid_to_row = parse_param_rows(lines_out)

added = 0
updated = 0
unchanged = 0
added_sample = []
updated_sample = []

for row in param_packet:
    g = safe_str(row.get("ParamGuid")).upper()
    n = safe_str(row.get("ParamName"))
    tip = safe_str(row.get("ParamTip"))

    action = upsert_param_row(lines_out, guid_to_row, g, n, tip, make_num)

    if action == "added":
        added += 1
        if len(added_sample) < 20:
            added_sample.append({"ParamName": n, "Guid": g})
    elif action == "updated":
        updated += 1
        if len(updated_sample) < 20:
            updated_sample.append({"ParamName": n, "Guid": g})
    else:
        unchanged += 1

report["AddedNewParams"] = int(added)
report["UpdatedExistingParams"] = int(updated)
report["UnchangedParams"] = int(unchanged)
report["AddedSample"] = added_sample
report["UpdatedSample"] = updated_sample

final_path, warn = safe_write_lines(sp_path, lines_out)
if warn:
    notes.append(warn)
if final_path != sp_path:
    report["SharedParamFilePath_AltWritten"] = final_path
    sp_path = final_path

report["SharedParamFilePath"] = sp_path
report["WroteFile"] = True if os.path.exists(sp_path) else False
report["Notes"] = notes

OUT = [sp_path, param_names_out, rev_id_to_param_out, report, param_packet, param_name_to_guid]
# ----------------------------------------
watch = Watch(py_revparams_2)
py_revparams_purgelikely_py = Python(IN[0]=py_revparams_2)  # CPython3
# ---------- py_revparams_purgelikely_py.python (472 lines) ----------
# [py.RevParams-PurgeLikely.py]
# V00-04-2026-01-31t0000p
# encoding: utf-8
# Purpose:
#   Purge ONLY what needs purging:
#     - remove bindings + delete ParameterElements when:
#         (A) name matches our rule-set AND
#         (B) GUID mismatches expected OR UserModifiable mismatches expected
#   Pass-through stream for downstream bind/stamp nodes.

import clr
import re
from datetime import datetime

#####################################
## 0000_Revit-Imports-And-Context()
#####################################
clr.AddReference("RevitServices")
from RevitServices.Persistence import DocumentManager

clr.AddReference("RevitAPI")
from Autodesk.Revit.DB import (
    BuiltInCategory,
    ElementId,
    FilteredElementCollector,
    ParameterElement,
    SharedParameterElement,
    Transaction,
    TransactionGroup,
    ViewSheet,
)

doc = DocumentManager.Instance.CurrentDBDocument

#####################################
## 0001_Read-Inputs()
#####################################
write_out = IN[0] if IN and len(IN) > 0 else None

#####################################
## 0100_Utilities()
#####################################
def safe_str(x):
    try:
        return "" if x is None else str(x)
    except:
        return ""

def _unwrap_singleton_list(obj):
    try:
        if isinstance(obj, (list, tuple)) and len(obj) == 1:
            return obj[0]
    except:
        pass
    return obj

def _as_list(x):
    if x is None:
        return []
    try:
        return list(x)
    except:
        return []

#####################################
## 0110_Stream-Extraction
#####################################
def extract_stream_packet(obj):
    """
    Supports:
      - dict packet
      - writer list packet:
          [0]=sp_path, [1]=ParamNames, [2]=RevIdToParam, [3]=Report, [4]=ParamPacket, [5]=ParamNameToGuid
    """
    obj = _unwrap_singleton_list(obj)

    sp_path = ""
    param_names = []
    rev_id_to_param = {}
    rev_prefix = ""
    group_assignment = "Text"
    sp_group_name = "DynamoProjectLocal"
    make_non_user_mod = None
    param_packet = None
    param_name_to_guid = None

    if isinstance(obj, dict):
        sp_path = safe_str(obj.get("SharedParamFilePath") or obj.get("FilePath") or "")
        sp_group_name = safe_str(obj.get("SharedParamGroupName") or obj.get("GroupNameInFile") or sp_group_name)
        param_names = obj.get("ParamNames") or []
        rev_id_to_param = obj.get("RevIdToParam") or {}
        rev_prefix = safe_str(obj.get("RevPrefix") or obj.get("revPrefix") or "")
        group_assignment = obj.get("ParamGroupAssignment") or obj.get("ParamGroupAssignment_Input") or group_assignment

        # optional new fields
        make_non_user_mod = obj.get("MakeNonUserModifiable")
        param_packet = obj.get("ParamPacket")
        param_name_to_guid = obj.get("ParamNameToGuid")

        # sometimes stored in Report subdict
        rep = obj.get("Report")
        if isinstance(rep, dict):
            make_non_user_mod = rep.get("MakeNonUserModifiable", make_non_user_mod)

    elif isinstance(obj, (list, tuple)):
        if len(obj) >= 1 and isinstance(obj[0], str):
            sp_path = safe_str(obj[0])
        if len(obj) >= 2 and isinstance(obj[1], list):
            param_names = obj[1]
        if len(obj) >= 3 and isinstance(obj[2], dict):
            rev_id_to_param = obj[2]
        if len(obj) >= 4 and isinstance(obj[3], dict):
            rep = obj[3]
            rev_prefix = safe_str(rep.get("RevPrefix") or rep.get("RevPrefix_Stream") or "")
            group_assignment = rep.get("ParamGroupAssignment_Input") or rep.get("ParamGroupAssignment") or group_assignment
            sp_group_name = safe_str(rep.get("GroupNameInFile") or rep.get("SharedParamGroupName") or sp_group_name)
            make_non_user_mod = rep.get("MakeNonUserModifiable", make_non_user_mod)
            sp_path = sp_path or safe_str(rep.get("SharedParamFilePath") or "")

        if len(obj) >= 5 and isinstance(obj[4], list):
            param_packet = obj[4]
        if len(obj) >= 6 and isinstance(obj[5], dict):
            param_name_to_guid = obj[5]

    # normalize param names
    try:
        param_names = [safe_str(x) for x in param_names if x is not None and safe_str(x).strip()]
    except:
        param_names = []

    # normalize RevIdToParam passthrough keys to strings for Dynamo safety
    rev_map_out = {}
    try:
        for k, v in (rev_id_to_param or {}).items():
            try:
                rev_map_out[str(int(k))] = safe_str(v)
            except:
                rev_map_out[safe_str(k)] = safe_str(v)
    except:
        rev_map_out = {}

    return {
        "SharedParamFilePath": sp_path,
        "SharedParamGroupName": sp_group_name,
        "ParamNames": param_names,
        "RevIdToParam": rev_map_out,
        "RevPrefix": (rev_prefix or "REV").strip(),
        "ParamGroupAssignment": group_assignment,
        "MakeNonUserModifiable": bool(make_non_user_mod) if make_non_user_mod is not None else None,
        "ParamPacket": param_packet,
        "ParamNameToGuid": param_name_to_guid,
    }

#####################################
## 0200_Expected GUID map + expected UserModifiable
#####################################
def build_expected_guid_map(packet):
    # Prefer ParamNameToGuid, else ParamPacket, else empty
    name_to_guid = {}

    m = packet.get("ParamNameToGuid")
    if isinstance(m, dict) and m:
        for k, v in m.items():
            ks = safe_str(k).strip()
            vs = safe_str(v).strip().upper()
            if ks and vs:
                name_to_guid[ks] = vs
        return name_to_guid

    pp = packet.get("ParamPacket")
    if isinstance(pp, list):
        for row in pp:
            if not isinstance(row, dict):
                continue
            pname = safe_str(row.get("ParamName")).strip()
            guid = safe_str(row.get("ParamGuid")).strip().upper()
            if pname and guid:
                name_to_guid[pname] = guid

    return name_to_guid

def get_expected_user_modifiable(packet):
    # expected UserModifiable = NOT MakeNonUserModifiable
    mnm = packet.get("MakeNonUserModifiable")
    if mnm is None:
        return None  # unknown
    return (not bool(mnm))

#####################################
## 0300_Model Inspection helpers
#####################################
def get_current_usermod_from_any_sheet(pname):
    """
    Try to read Definition.UserModifiable from a real parameter instance on a sheet.
    Returns: True/False/None (None if not detectable or not present).
    """
    try:
        sh = FilteredElementCollector(doc).OfClass(ViewSheet).FirstElement()
        if sh is None:
            return None
    except:
        return None

    # Better: scan a few sheets until we find this parameter
    try:
        sheets = list(FilteredElementCollector(doc).OfClass(ViewSheet).ToElements())
    except:
        sheets = []

    for sh in sheets[:30]:
        try:
            p = sh.LookupParameter(pname)
        except:
            p = None
        if p is None:
            continue

        try:
            d = p.Definition
            # many versions have this:
            if hasattr(d, "UserModifiable"):
                return bool(d.UserModifiable)
        except:
            return None

    return None

def get_existing_sharedparam_element_by_name(pname):
    """
    Returns SharedParameterElement if found by Name, else None.
    """
    try:
        for pe in FilteredElementCollector(doc).OfClass(ParameterElement).ToElements():
            try:
                if safe_str(pe.Name) == pname:
                    # only shared parameters have GuidValue
                    if isinstance(pe, SharedParameterElement):
                        return pe
            except:
                pass
    except:
        pass
    return None

#####################################
## 0400_Matching rules for candidate names
#####################################
def build_candidate_matcher(rev_prefix, param_names):
    prefix = safe_str(rev_prefix).strip()
    prefix_no_dot = prefix[:-1] if prefix.endswith(".") else prefix
    param_name_set = set([safe_str(x) for x in (param_names or []) if safe_str(x)])
    rx_date8 = re.compile(r"\d{8}")

    rx_revword = None
    try:
        if prefix_no_dot:
            rx_revword = re.compile(r"^%s.*revision" % re.escape(prefix_no_dot), re.IGNORECASE)
    except:
        rx_revword = None

    def is_candidate(n):
        n = safe_str(n).strip()
        if not n:
            return False
        if n in param_name_set:
            return True
        if prefix and n.startswith(prefix) and rx_date8.search(n):
            return True
        if rx_revword is not None and rx_revword.search(n):
            return True
        return False

    return is_candidate

#####################################
## 0500_Purge operations
#####################################
def remove_bindings_for_names(doc_, names_set):
    removed = 0
    matched = []
    try:
        bm = doc_.ParameterBindings
        it = bm.ForwardIterator()
        it.Reset()

        defs_to_remove = []
        while it.MoveNext():
            try:
                d = it.Key
                if d and safe_str(d.Name) in names_set:
                    defs_to_remove.append(d)
                    if len(matched) < 30:
                        matched.append(safe_str(d.Name))
            except:
                pass

        for d in defs_to_remove:
            try:
                if bm.Remove(d):
                    removed += 1
            except:
                pass
    except:
        pass

    return removed, matched

def delete_param_elements_for_names(doc_, names_set):
    deleted = 0
    matched = []
    ids = []
    try:
        for pe in FilteredElementCollector(doc_).OfClass(ParameterElement).ToElements():
            try:
                n = safe_str(pe.Name)
                if n in names_set:
                    ids.append(pe.Id)
                    if len(matched) < 30:
                        matched.append(n)
            except:
                pass
    except:
        pass

    for eid in ids:
        try:
            doc_.Delete(eid)
            deleted += 1
        except:
            pass

    return deleted, matched

#####################################
## 0900_Main
#####################################
runtime_stamp = datetime.now().strftime("%Y-%m-%dT%H:%M:%S")
packet = extract_stream_packet(write_out)

param_names = packet["ParamNames"]
rev_prefix = packet["RevPrefix"]

expected_guid_map = build_expected_guid_map(packet)
expected_user_mod = get_expected_user_modifiable(packet)  # True/False/None

# Decide which names MUST be purged
is_candidate = build_candidate_matcher(rev_prefix, param_names)

purge_names = set()
keep_names = set()
reasons = []

for pname in param_names:
    if not is_candidate(pname):
        continue

    exp_guid = safe_str(expected_guid_map.get(pname, "")).upper()
    spe = get_existing_sharedparam_element_by_name(pname)

    if spe is None:
        # doesn't exist -> nothing to purge
        keep_names.add(pname)
        continue

    # GUID check
    cur_guid = ""
    try:
        cur_guid = safe_str(spe.GuidValue).upper()
    except:
        cur_guid = ""

    guid_mismatch = (exp_guid and cur_guid and exp_guid != cur_guid)

    # UserModifiable check (best effort)
    cur_user_mod = get_current_usermod_from_any_sheet(pname)  # True/False/None
    usermod_mismatch = False
    if expected_user_mod is not None and cur_user_mod is not None:
        usermod_mismatch = (bool(expected_user_mod) != bool(cur_user_mod))

    # If we cannot detect current user-mod state, but user requested a state,
    # and the parameter exists, be conservative and purge when flipping matters:
    # We treat "expected_user_mod is not None and cur_user_mod is None" as "unknown".
    # If you want "always purge when unknown", keep this True:
    unknown_usermod_needs_recreate = (expected_user_mod is not None and cur_user_mod is None)

    if guid_mismatch or usermod_mismatch or unknown_usermod_needs_recreate:
        purge_names.add(pname)
        reasons.append({
            "Param": pname,
            "GuidExpected": exp_guid,
            "GuidCurrent": cur_guid,
            "GuidMismatch": guid_mismatch,
            "UserModExpected": expected_user_mod,
            "UserModCurrent": cur_user_mod,
            "UserModMismatch": usermod_mismatch,
            "UserModUnknownForced": unknown_usermod_needs_recreate,
        })
    else:
        keep_names.add(pname)

removed_bindings = 0
deleted_param_elements = 0
matched_binding_names = []
matched_param_element_names = []

tg = TransactionGroup(doc, "RevParams Purge (GUID/UserMod aware)")
try:
    tg.Start()

    t1 = Transaction(doc, "Purge Bindings (mismatched only)")
    t1.Start()
    removed_bindings, matched_binding_names = remove_bindings_for_names(doc, purge_names)
    t1.Commit()

    t2 = Transaction(doc, "Delete ParameterElements (mismatched only)")
    t2.Start()
    deleted_param_elements, matched_param_element_names = delete_param_elements_for_names(doc, purge_names)
    t2.Commit()

    tg.Assimilate()

    OUT = {
        # passthrough
        "SharedParamFilePath": packet["SharedParamFilePath"],
        "SharedParamGroupName": packet["SharedParamGroupName"],
        "ParamNames": param_names,
        "RevIdToParam": packet["RevIdToParam"],
        "RevPrefix": rev_prefix,
        "ParamGroupAssignment": packet["ParamGroupAssignment"],
        "MakeNonUserModifiable": packet["MakeNonUserModifiable"],
        "ParamNameToGuid": expected_guid_map,

        # purge report
        "RuntimeStamp": runtime_stamp,
        "PurgedParamNames": sorted(list(purge_names)),
        "KeptParamNames": sorted(list(keep_names)),
        "RemovedBindings": removed_bindings,
        "DeletedParameterElements": deleted_param_elements,
        "MatchedBindingNamesSample": matched_binding_names,
        "MatchedParamElementNamesSample": matched_param_element_names,
        "MismatchReasonsSample": reasons[:25],
        "Report": {
            "RuntimeStamp": runtime_stamp,
            "ExpectedUserModifiable": expected_user_mod,
            "ParamNamesCount": len(param_names),
            "PurgeCount": len(purge_names),
            "KeepCount": len(keep_names),
            "RemovedBindings": removed_bindings,
            "DeletedParameterElements": deleted_param_elements,
        },
        "Notes": [],
    }

except Exception as ex:
    try:
        if tg.HasStarted() and not tg.HasEnded():
            tg.RollBack()
    except:
        pass

    OUT = {
        "SharedParamFilePath": packet["SharedParamFilePath"],
        "SharedParamGroupName": packet["SharedParamGroupName"],
        "ParamNames": param_names,
        "RevIdToParam": packet["RevIdToParam"],
        "RevPrefix": rev_prefix,
        "ParamGroupAssignment": packet["ParamGroupAssignment"],
        "MakeNonUserModifiable": packet["MakeNonUserModifiable"],
        "ParamNameToGuid": expected_guid_map,
        "RuntimeStamp": runtime_stamp,
        "error": safe_str(ex),
    }
# ----------------------------------------
watch_2 = Watch(py_revparams_purgelikely_py)
py_revparams_bindtosheets_py = Python(IN[0]=py_revparams_purgelikely_py)  # CPython3
# ---------- py_revparams_bindtosheets_py.python (471 lines) ----------
# [py.RevParams-BindToSheets.py]
# V00-03-2026-01-31t1205p
# encoding: utf-8
# Purpose and IO:
#   Binds a provided list of Shared Parameter DEFINITIONS (by name) to OST_Sheets as INSTANCE parameters.
#   Accepts packet from EITHER:
#     - py.RevParams-WriteSharedParamFile.py (LIST-style)
#     - py.RevParams-PurgeLikely.py (DICT-style passthrough)
#
#   IMPORTANT:
#     - This node DOES NOT stamp values.
#     - This node PASSES THROUGH ParamNames + RevIdToParam + SharedParamFilePath so the next node can stamp.
#
#   RELIABILITY UPDATE:
#     - After freeze/thaw, Revit can "no-op" Insert/ReInsert if an existing bound Definition (same Name)
#       is stale or mismatched. We now fallback to:
#         (1) find bound Definition by NAME
#         (2) bm.Remove(oldDef)
#         (3) Insert/ReInsert using ext_def from shared param file
#
# Inputs:
#   IN[0]=UpstreamOut (dict/list)
#   IN[1]=ParamGroupAssignmentOverride (string or bool) OPTIONAL
#
# Outputs:
#   OUT=dict packet:
#     SharedParamFilePath, SharedParamGroupName, ParamGroupAssignment, RevPrefix,
#     ParamNames, RevIdToParam,
#     Report, Debug, Notes

import clr
import os
from datetime import datetime

#####################################
## 0000_Revit-Imports-And-Context()
#####################################
clr.AddReference("RevitServices")
from RevitServices.Persistence import DocumentManager
from RevitServices.Transactions import TransactionManager

clr.AddReference("RevitAPI")
from Autodesk.Revit.DB import (
    BuiltInCategory,
    Category,
    ElementId,
)

try:
    from Autodesk.Revit.DB import GroupTypeId
except:
    GroupTypeId = None

try:
    from Autodesk.Revit.DB import BuiltInParameterGroup
except:
    BuiltInParameterGroup = None

doc = DocumentManager.Instance.CurrentDBDocument
app = doc.Application

#####################################
## 0001_Read-Inputs()
#####################################
upstream_out = IN[0] if IN and len(IN) > 0 else None
group_override = IN[1] if IN and len(IN) > 1 and IN[1] is not None else None

#####################################
## 0100_Utilities()
#####################################
def safe_str(x):
    """Comment: defensive string conversion for Dynamo/Revit mixed types."""
    try:
        return "" if x is None else str(x)
    except:
        return ""

def _unwrap_singleton_list(obj):
    """Comment: unwrap one level if Dynamo wraps as [ [packet] ]."""
    try:
        if isinstance(obj, (list, tuple)) and len(obj) == 1:
            return obj[0]
    except:
        pass
    return obj

def _norm_group_name(name):
    """Comment: normalize group name input for mapping."""
    n = safe_str(name).strip().lower()
    n = n.replace("_", " ").replace("-", " ")
    return " ".join(n.split())

def resolve_param_group_token(group_input_value):
    """
    Comment: map friendly group string (or legacy bool) to a group token.
    Returns (token, resolved_label, normalized_name).
    """
    if isinstance(group_input_value, bool):
        norm = "identity data" if bool(group_input_value) else "other"
    else:
        norm = _norm_group_name(group_input_value) or "text"

    friendly_to_group_typeid = {
        "identity data": "IdentityData",
        "identity": "IdentityData",
        "text": "Text",
        "data": "Data",
        "other": "Other",
        "constraints": "Constraints",
        "graphics": "Graphics",
        "phasing": "Phasing",
        "materials": "Materials",
        "general": "General",
    }

    friendly_to_bipg = {
        "identity data": "PG_IDENTITY_DATA",
        "identity": "PG_IDENTITY_DATA",
        "text": "PG_TEXT",
        "data": "PG_DATA",
        "other": "PG_OTHER",
        "constraints": "PG_CONSTRAINTS",
        "graphics": "PG_GRAPHICS",
        "phasing": "PG_PHASING",
        "materials": "PG_MATERIALS",
        "general": "PG_GENERAL",
    }

    if GroupTypeId is not None:
        member = friendly_to_group_typeid.get(norm)
        if member and hasattr(GroupTypeId, member):
            return getattr(GroupTypeId, member), member, norm

    if BuiltInParameterGroup is not None:
        member = friendly_to_bipg.get(norm)
        if member and hasattr(BuiltInParameterGroup, member):
            return getattr(BuiltInParameterGroup, member), member, norm

    return None, "UNRESOLVED", norm

def extract_bind_packet(obj):
    """
    Comment:
      Supports BOTH:
        (A) dict packet with SharedParamFilePath + ParamNames + ParamGroupAssignment
        (B) writer list packet:
            [0]=SharedParamFilePath (string)
            [1]=ParamNames (list)
            [2]=RevIdToParam (dict)
            [3]=Report (dict)
    Returns:
      sp_path, param_names, rev_id_to_param, group_assignment, sp_group_name, rev_prefix
    """
    obj = _unwrap_singleton_list(obj)

    sp_path = ""
    param_names = []
    rev_id_to_param = {}
    group_assignment = "Text"
    sp_group_name = "DynamoProjectLocal"
    rev_prefix = ""

    if isinstance(obj, dict):
        sp_path = safe_str(obj.get("SharedParamFilePath") or obj.get("sharedParamFile") or obj.get("FilePath"))
        param_names = obj.get("ParamNames") or []
        rev_id_to_param = obj.get("RevIdToParam") or {}
        group_assignment = (
            obj.get("ParamGroupAssignment")
            or obj.get("ParamGroupAssignment_Input")
            or obj.get("ParamGroupName")
            or group_assignment
        )
        sp_group_name = safe_str(obj.get("SharedParamGroupName") or obj.get("GroupNameInFile") or obj.get("SharedParamGroup") or sp_group_name)
        rev_prefix = safe_str(obj.get("RevPrefix") or obj.get("revPrefix") or "")

    elif isinstance(obj, (list, tuple)):
        if len(obj) >= 1 and isinstance(obj[0], str) and obj[0].lower().endswith(".txt"):
            sp_path = safe_str(obj[0])

        if len(obj) >= 2 and isinstance(obj[1], list):
            param_names = obj[1]

        if len(obj) >= 3 and isinstance(obj[2], dict):
            rev_id_to_param = obj[2]

        if len(obj) >= 4 and isinstance(obj[3], dict):
            rep = obj[3]
            sp_path = sp_path or safe_str(rep.get("SharedParamFilePath") or "")
            rev_prefix = safe_str(rep.get("RevPrefix") or rep.get("RevPrefix_Stream") or rev_prefix)
            group_assignment = (
                rep.get("ParamGroupAssignment_Input")
                or rep.get("ParamGroupAssignment")
                or rep.get("ParamGroupName")
                or group_assignment
            )
            sp_group_name = safe_str(rep.get("GroupNameInFile") or rep.get("SharedParamGroupName") or sp_group_name)

    # normalize
    try:
        param_names = [safe_str(x) for x in param_names if x is not None and safe_str(x).strip()]
    except:
        param_names = []

    # normalize rev map keys to strings for Dynamo safety
    rev_map_out = {}
    try:
        for k, v in (rev_id_to_param or {}).items():
            try:
                rev_map_out[str(int(k))] = safe_str(v)
            except:
                rev_map_out[safe_str(k)] = safe_str(v)
    except:
        rev_map_out = {}

    return safe_str(sp_path), param_names, rev_map_out, group_assignment, (safe_str(sp_group_name) or "DynamoProjectLocal"), safe_str(rev_prefix)

#####################################
## 0200_Bind-Helpers()
#####################################
def open_shared_param_file_force(app_, sp_path, notes_list):
    """
    Comment:
      Force-open the shared parameter file even after freeze/thaw.
      Clearing SharedParametersFilename first helps flush stale file handles.
    """
    old_sp = app_.SharedParametersFilename
    sp_file = None
    try:
        try:
            app_.SharedParametersFilename = ""
        except:
            pass
        app_.SharedParametersFilename = sp_path
        sp_file = app_.OpenSharedParameterFile()
    finally:
        try:
            app_.SharedParametersFilename = old_sp
        except:
            notes_list.append("Warning: failed to restore SharedParametersFilename.")
    return sp_file

def find_bound_definition_by_name(doc_, target_name):
    """
    Comment:
      Search BindingMap for a Definition whose Name == target_name.
      Returns the Definition object or None.
    """
    try:
        bm = doc_.ParameterBindings
        it = bm.ForwardIterator()
        it.Reset()
        while it.MoveNext():
            try:
                d = it.Key
                if d and safe_str(d.Name) == target_name:
                    return d
            except:
                pass
    except:
        pass
    return None

def bind_param_to_sheets_robust(doc_, app_, ext_def, group_token, pname, debug_counts, fail_list):
    """
    Comment:
      Robust binder:
        1) Insert
        2) ReInsert
        3) Remove old def by name, then Insert
        4) Remove old def by name, then ReInsert
    """
    cats = app_.Create.NewCategorySet()
    sheets_cat = Category.GetCategory(doc_, BuiltInCategory.OST_Sheets)
    cats.Insert(sheets_cat)
    binding = app_.Create.NewInstanceBinding(cats)
    bm = doc_.ParameterBindings

    # 1) Insert
    try:
        if bm.Insert(ext_def, binding, group_token):
            debug_counts["InsertOK"] += 1
            return True
    except:
        pass

    # 2) ReInsert
    try:
        if bm.ReInsert(ext_def, binding, group_token):
            debug_counts["ReInsertOK"] += 1
            return True
    except:
        pass

    # 3/4) Remove old by name and retry
    old_def = find_bound_definition_by_name(doc_, pname)
    if old_def is not None:
        try:
            bm.Remove(old_def)
            debug_counts["RemovedOldByName"] += 1
        except:
            pass

        try:
            if bm.Insert(ext_def, binding, group_token):
                debug_counts["RemoveThenInsertOK"] += 1
                return True
        except:
            pass

        try:
            if bm.ReInsert(ext_def, binding, group_token):
                debug_counts["RemoveThenReInsertOK"] += 1
                return True
        except:
            pass

    fail_list.append({"Param": pname, "Reason": "Insert/ReInsert failed (even after RemoveByName fallback)."})
    return False

#####################################
## 0900_Main()
#####################################
notes = []
debug = {}
runtime_stamp = datetime.now().strftime("%Y-%m-%dT%H:%M:%S")

sp_path, param_names, rev_id_to_param_out, group_assignment_stream, sp_group_name, rev_prefix = extract_bind_packet(upstream_out)
group_assignment = group_override if group_override is not None else group_assignment_stream
group_token, group_label, group_norm = resolve_param_group_token(group_assignment)

debug["Extracted"] = {
    "SharedParamFilePath": sp_path,
    "SharedParamGroupName": sp_group_name,
    "ParamNamesCount": len(param_names),
    "RevIdToParamCount": len(rev_id_to_param_out),
    "RevPrefix": rev_prefix,
    "ParamGroupAssignment_Stream": safe_str(group_assignment_stream),
    "ParamGroupAssignment_Final": safe_str(group_assignment),
}

# basic guards
if not sp_path or not os.path.exists(sp_path):
    OUT = {
        "SharedParamFilePath": sp_path,
        "SharedParamGroupName": sp_group_name,
        "ParamGroupAssignment": safe_str(group_assignment),
        "RevPrefix": rev_prefix,
        "ParamNames": param_names,
        "RevIdToParam": rev_id_to_param_out,
        "RuntimeStamp": runtime_stamp,
        "Report": {"error": "SharedParamFilePath missing or file does not exist.", "Path": safe_str(sp_path)},
        "Debug": debug,
        "Notes": notes,
    }

elif not param_names:
    OUT = {
        "SharedParamFilePath": sp_path,
        "SharedParamGroupName": sp_group_name,
        "ParamGroupAssignment": safe_str(group_assignment),
        "RevPrefix": rev_prefix,
        "ParamNames": param_names,
        "RevIdToParam": rev_id_to_param_out,
        "RuntimeStamp": runtime_stamp,
        "Report": {"error": "ParamNames missing/empty from stream."},
        "Debug": debug,
        "Notes": notes,
    }

elif group_token is None:
    OUT = {
        "SharedParamFilePath": sp_path,
        "SharedParamGroupName": sp_group_name,
        "ParamGroupAssignment": safe_str(group_assignment),
        "RevPrefix": rev_prefix,
        "ParamNames": param_names,
        "RevIdToParam": rev_id_to_param_out,
        "RuntimeStamp": runtime_stamp,
        "Report": {
            "error": "Could not resolve a valid parameter group token.",
            "ParamGroupResolved": group_label,
            "ParamGroupNormalized": group_norm,
        },
        "Debug": debug,
        "Notes": notes,
    }

else:
    failed = []
    bound_count = 0
    counts = {"InsertOK": 0, "ReInsertOK": 0, "RemovedOldByName": 0, "RemoveThenInsertOK": 0, "RemoveThenReInsertOK": 0}

    try:
        TransactionManager.Instance.EnsureInTransaction(doc)

        # Force open shared parameter file (flush stale handles after freeze/thaw)
        sp_file = open_shared_param_file_force(app, sp_path, notes)

        if sp_file is None:
            failed.append({"error": "Could not open shared parameter file.", "path": sp_path})
        else:
            try:
                sp_group = sp_file.Groups.get_Item(sp_group_name)
            except:
                sp_group = None

            if sp_group is None:
                failed.append({"error": "Shared parameter GROUP not found in file.", "group": sp_group_name})
            else:
                for pname in param_names:
                    pname_s = safe_str(pname)
                    try:
                        ext_def = sp_group.Definitions.get_Item(pname_s)
                    except:
                        ext_def = None

                    if ext_def is None:
                        failed.append({"Param": pname_s, "Reason": "Definition not found in shared parameter file group."})
                        continue

                    if bind_param_to_sheets_robust(doc, app, ext_def, group_token, pname_s, counts, failed):
                        bound_count += 1

        # Helps after freeze/thaw when bindings “exist” but UI/schedules don’t refresh
        try:
            doc.Regenerate()
        except:
            pass

        TransactionManager.Instance.TransactionTaskDone()

        debug["BindStrategyCounts"] = counts

        OUT = {
            "SharedParamFilePath": sp_path,
            "SharedParamGroupName": sp_group_name,
            "ParamGroupAssignment": safe_str(group_assignment),
            "RevPrefix": rev_prefix,
            "ParamNames": param_names,
            "RevIdToParam": rev_id_to_param_out,
            "RuntimeStamp": runtime_stamp,
            "Report": {
                "ParamGroupResolved": group_label,
                "ParamGroupNormalized": group_norm,
                "ParamNamesCount": len(param_names),
                "BoundCount": bound_count,
                "FailedCount": len(failed),
                "FailedSample": failed[:25],
            },
            "Debug": debug,
            "Notes": notes,
        }

    except Exception as ex:
        try:
            TransactionManager.Instance.ForceCloseTransaction()
        except:
            pass

        OUT = {
            "SharedParamFilePath": sp_path,
            "SharedParamGroupName": sp_group_name,
            "ParamGroupAssignment": safe_str(group_assignment),
            "RevPrefix": rev_prefix,
            "ParamNames": param_names,
            "RevIdToParam": rev_id_to_param_out,
            "RuntimeStamp": runtime_stamp,
            "Report": {"error": safe_str(ex)},
            "Debug": debug,
            "Notes": notes,
        }
# ----------------------------------------
watch_3 = Watch(py_revparams_bindtosheets_py)

# group: Sheet Data
n04_marker_symbol = StringInput("●")  # "04.Marker Symbol"; graph input
n05_only_add_sheets_with = BoolSelector(false)  # "05.Only Add Sheets With Revisions"
n06_only_show_issued_revisions = BoolSelector(false)  # "06.Only Show Issued Revisions(TRUE)"; graph input
n07_clear_unset_sheets_true = BoolSelector(true)  # "07.Clear unset Sheets(TRUE)"

py_revparams_stampsheets_py = Python(IN[0]=py_revparams_bindtosheets_py, IN[1]=n04_marker_symbol, IN[2]=n05_only_add_sheets_with, IN[3]=n06_only_show_issued_revisions, IN[4]=n07_clear_unset_sheets_true)  # CPython3
# ---------- py_revparams_stampsheets_py.python (568 lines) ----------
# [py.RevParams-StampSheets.py]
# V00-02-2026-01-31t1525p
# encoding: utf-8

import clr
import re
from datetime import datetime

#####################################
## 0000_Revit-Imports-And-Context()
#####################################
clr.AddReference("RevitServices")
from RevitServices.Persistence import DocumentManager
from RevitServices.Transactions import TransactionManager

clr.AddReference("RevitAPI")
from Autodesk.Revit.DB import (
    BuiltInCategory,
    BuiltInParameter,
    ElementId,
    FilteredElementCollector,
    Revision,
    ViewSheet,
)

doc = DocumentManager.Instance.CurrentDBDocument

#####################################
## 0001_Read-Inputs()
#####################################
packet_in = IN[0] if IN and len(IN) > 0 else None

true_symbol_raw = IN[1] if IN and len(IN) > 1 else None
only_add_sheets_with_revs = IN[2] if IN and len(IN) > 2 and IN[2] is not None else True
only_show_issued = IN[3] if IN and len(IN) > 3 and IN[3] is not None else True
clear_not_included = IN[4] if IN and len(IN) > 4 and IN[4] is not None else False

MRK = u"\u25CF"  # ●
try:
    TRUE_SYMBOL = MRK if true_symbol_raw is None else (str(true_symbol_raw) if str(true_symbol_raw).strip() else MRK)
except:
    TRUE_SYMBOL = MRK

#####################################
## 0100_Utilities()
#####################################
def safe_str(x):
    try:
        return "" if x is None else str(x)
    except:
        return ""

def _as_list(x):
    if x is None:
        return []
    try:
        return list(x)
    except:
        return []

def _unwrap_singleton_list(obj):
    try:
        if isinstance(obj, (list, tuple)) and len(obj) == 1:
            return obj[0]
    except:
        pass
    return obj

def _fail_loud(reason, hint=None, extract=None, errors=None):
    msg = "StampSheets input/operation validation failed\n"
    msg += "Reason={}\n".format(safe_str(reason))
    if hint:
        msg += "Hint={}\n".format(safe_str(hint))
    if extract:
        msg += "Extract={}\n".format(safe_str(extract))
    if errors:
        msg += "ErrorCount={}\n".format(len(errors))
        for e in errors[:20]:
            msg += "- {}\n".format(safe_str(e))
        if len(errors) > 20:
            msg += "- ... ({} more)\n".format(len(errors) - 20)
    raise Exception(msg)

#####################################
## 0120_Canonical-Name-Rebuild
#####################################
MAX_LEN_6BIT = int(128 / 6)  # 21

def to_yyyymmdd(date_str):
    s = safe_str(date_str).strip()
    if not s:
        return "00000000"

    m = re.match(r"^\s*(\d{4})[-/](\d{1,2})[-/](\d{1,2})\s*$", s)
    if m:
        y = m.group(1)
        mo = "{:02d}".format(int(m.group(2)))
        d = "{:02d}".format(int(m.group(3)))
        return "{}{}{}".format(y, mo, d)

    m = re.match(r"^\s*(\d{1,2})[-/](\d{1,2})[-/](\d{4})\s*$", s)
    if m:
        mo = "{:02d}".format(int(m.group(1)))
        d = "{:02d}".format(int(m.group(2)))
        y = m.group(3)
        return "{}{}{}".format(y, mo, d)

    digits = re.sub(r"\D+", "", s)
    if len(digits) >= 8:
        digits = digits[:8]
        if digits.startswith("19") or digits.startswith("20"):
            return digits
        mm = digits[0:2]
        dd = digits[2:4]
        yy = digits[4:8]
        if yy.startswith("19") or yy.startswith("20"):
            return "{}{}{}".format(yy, mm, dd)

    return "00000000"

def compress_desc_to_snippet(desc):
    s = safe_str(desc).upper()
    s = re.sub(r"[^A-Z0-9]+", "", s)
    return s or "X"

def build_canonical_param_name(prefix, yyyymmdd, desc, max_len=MAX_LEN_6BIT, desired_snip=10):
    pfx = safe_str(prefix)
    base = "{}{}".format(pfx, yyyymmdd)
    remaining = max_len - len(base)
    if remaining <= 0:
        return base[:max_len]
    snippet = compress_desc_to_snippet(desc)
    snip_len = min(desired_snip, remaining)
    return (base + snippet[:snip_len])[:max_len]

#####################################
## 0150_Packet-Extraction()
#####################################
def extract_stamp_packet(obj):
    obj = _unwrap_singleton_list(obj)

    sp_path = ""
    sp_group_name = ""
    group_assignment = ""
    rev_prefix = ""

    param_names = []
    rev_map_raw = {}

    if isinstance(obj, dict):
        sp_path = safe_str(obj.get("SharedParamFilePath") or obj.get("FilePath") or "")
        sp_group_name = safe_str(obj.get("SharedParamGroupName") or obj.get("GroupNameInFile") or "")
        group_assignment = safe_str(obj.get("ParamGroupAssignment") or obj.get("ParamGroupAssignment_Input") or "")
        rev_prefix = safe_str(obj.get("RevPrefix") or obj.get("revPrefix") or "")
        param_names = obj.get("ParamNames") or []
        rev_map_raw = obj.get("RevIdToParam") or {}

    elif isinstance(obj, (list, tuple)):
        if len(obj) >= 1 and isinstance(obj[0], str):
            sp_path = safe_str(obj[0])
        if len(obj) >= 2 and isinstance(obj[1], list):
            param_names = obj[1]
        if len(obj) >= 3 and isinstance(obj[2], dict):
            rev_map_raw = obj[2]
        if len(obj) >= 4 and isinstance(obj[3], dict):
            rep = obj[3]
            sp_path = sp_path or safe_str(rep.get("SharedParamFilePath") or "")
            sp_group_name = safe_str(rep.get("GroupNameInFile") or rep.get("SharedParamGroupName") or "")
            group_assignment = safe_str(rep.get("ParamGroupAssignment_Input") or rep.get("ParamGroupAssignment") or "")
            rev_prefix = safe_str(rep.get("RevPrefix") or rep.get("revPrefix") or "")

    try:
        param_names = [safe_str(x) for x in param_names if x is not None and safe_str(x).strip()]
    except:
        param_names = []

    rev_id_to_param = {}
    try:
        for k, v in (rev_map_raw or {}).items():
            try:
                rev_id_to_param[int(k)] = safe_str(v)
            except:
                pass
    except:
        rev_id_to_param = {}

    return sp_path, sp_group_name, group_assignment, rev_prefix, param_names, rev_id_to_param

def rebuild_rev_id_to_param_from_model(rev_prefix, param_names_set):
    rebuilt = {}
    revs = list(FilteredElementCollector(doc).OfClass(Revision).ToElements())
    for r in revs:
        try:
            rid = r.Id.IntegerValue
        except:
            continue
        try:
            rdate = safe_str(getattr(r, "RevisionDate", ""))
        except:
            rdate = ""
        try:
            rdesc = safe_str(getattr(r, "Description", ""))
        except:
            rdesc = ""
        yyyymmdd = to_yyyymmdd(rdate)
        pname = build_canonical_param_name(rev_prefix, yyyymmdd, rdesc)
        if pname in param_names_set:
            rebuilt[int(rid)] = pname
    return rebuilt

#####################################
## 0200_Revision-Inclusion-Detection()
#####################################
def get_revision_ids_from_clouds_in_view(doc_, view_id):
    ids = set()
    try:
        clouds = list(
            FilteredElementCollector(doc_, view_id)
            .OfCategory(BuiltInCategory.OST_RevisionClouds)
            .WhereElementIsNotElementType()
            .ToElements()
        )
        for c in clouds:
            rid = getattr(c, "RevisionId", None)
            if rid and isinstance(rid, ElementId):
                ids.add(rid.IntegerValue)
    except:
        pass
    return ids

def get_additional_revision_ids(sheet):
    ids = set()
    try:
        for rid in _as_list(sheet.GetAdditionalRevisionIds()):
            try:
                ids.add(rid.IntegerValue)
            except:
                pass
    except:
        pass
    return ids

def get_all_revision_ids(sheet):
    ids = set()
    try:
        fn = getattr(sheet, "GetAllRevisionIds", None)
        if fn is not None:
            for rid in _as_list(sheet.GetAllRevisionIds()):
                try:
                    ids.add(rid.IntegerValue)
                except:
                    pass
    except:
        pass
    return ids

def revision_is_issued(rev_elem):
    try:
        p = rev_elem.get_Parameter(BuiltInParameter.REVISION_ISSUED)
        if p:
            return int(p.AsInteger()) == 1
    except:
        pass
    try:
        return bool(getattr(rev_elem, "Issued", False))
    except:
        return False

def get_included_revision_ids(doc_, sheet, only_issued):
    addl = get_additional_revision_ids(sheet)
    all_ids = get_all_revision_ids(sheet)
    clouds_sheet = get_revision_ids_from_clouds_in_view(doc_, sheet.Id)

    clouds_views = set()
    try:
        for vid in _as_list(sheet.GetAllPlacedViews()):
            clouds_views.update(get_revision_ids_from_clouds_in_view(doc_, vid))
    except:
        pass

    included = set()
    included.update(addl)
    included.update(all_ids)
    included.update(clouds_sheet)
    included.update(clouds_views)

    if not only_issued:
        return included, addl, clouds_sheet, clouds_views, all_ids

    issued_only = set()
    for rid_int in included:
        try:
            rev_elem = doc_.GetElement(ElementId(int(rid_int)))
        except:
            rev_elem = None
        if rev_elem is None:
            continue
        if revision_is_issued(rev_elem):
            issued_only.add(int(rid_int))

    return issued_only, addl, clouds_sheet, clouds_views, all_ids

#####################################
## 0300_Param-Write()
#####################################
def get_sheet_param_by_name(sheet, pname):
    try:
        return sheet.LookupParameter(pname)
    except:
        return None

def set_string_param(p, target):
    try:
        if getattr(p, "IsReadOnly", False):
            return False, True, "Parameter IsReadOnly=True"
    except:
        pass

    try:
        cur = p.AsString()
        cur = "" if cur is None else str(cur)
    except:
        cur = ""

    if cur == target:
        return False, False, None

    try:
        p.Set(target)
        return True, False, None
    except Exception as ex1:
        try:
            p.SetValueString(target)
            return True, False, None
        except Exception as ex2:
            return False, True, "Set failed: {}; SetValueString failed: {}".format(ex1, ex2)

#####################################
## 0900_Main()
#####################################
notes = []
debug = {}
report = {}

runtime_stamp = datetime.now().strftime("%Y-%m-%dT%H:%M:%S")

sp_path, sp_group_name, group_assignment, rev_prefix, param_names, rev_id_to_param = extract_stamp_packet(packet_in)

extract_dbg = {
    "RuntimeStamp": runtime_stamp,
    "TopType": type(_unwrap_singleton_list(packet_in)).__name__,
    "SharedParamFilePath": sp_path,
    "SharedParamGroupName": sp_group_name,
    "ParamGroupAssignment": group_assignment,
    "RevPrefix": rev_prefix,
    "ParamNamesCount": len(param_names),
    "RevIdToParamCount": len(rev_id_to_param),
}

rev_prefix_used = (rev_prefix or "REV").strip()
param_names_set = set(param_names)

rebuilt = False
if len(rev_id_to_param) == 0 and param_names:
    rev_id_to_param = rebuild_rev_id_to_param_from_model(rev_prefix_used, param_names_set)
    rebuilt = True
    extract_dbg["RevIdToParamRebuiltCount"] = len(rev_id_to_param)

report.update({
    "RuntimeStamp": runtime_stamp,
    "SharedParamFilePath": sp_path,
    "SharedParamGroupName": sp_group_name,
    "ParamGroupAssignment": group_assignment,
    "RevPrefix": rev_prefix_used,
    "ParamNamesCount": len(param_names),
    "RevIdToParamCount": len(rev_id_to_param),
    "RevIdToParamRebuilt": bool(rebuilt),
    "TrueSymbol": TRUE_SYMBOL,
    "OnlyAddSheetsWithRevisions": bool(only_add_sheets_with_revs),
    "OnlyShowIssuedRevisions": bool(only_show_issued),
    "ClearNotIncluded": bool(clear_not_included),
})

errs = []
if not param_names:
    errs.append("ParamNames missing/empty from upstream packet.")
if not rev_id_to_param:
    errs.append("RevIdToParam missing/empty from upstream packet (and rebuild failed).")
if errs:
    _fail_loud(
        reason="; ".join(errs),
        hint="Upstream must provide ParamNames; RevIdToParam can rebuild only if model Revisions match canonical naming.",
        extract=extract_dbg,
        errors=errs
    )

# collect sheets
sheets = list(
    FilteredElementCollector(doc)
    .OfCategory(BuiltInCategory.OST_Sheets)
    .WhereElementIsNotElementType()
    .ToElements()
)
sheets = [s for s in sheets if isinstance(s, ViewSheet)]

set_cells = 0
cleared_cells = 0
sheets_processed = 0
sheets_skipped = 0

missing_param_errors = []
write_fail_errors = []
missing_map_errors = []
sheet_debug = []

# Dynamo-safe transaction
try:
    TransactionManager.Instance.EnsureInTransaction(doc)

    for sh in sheets:
        included_ids, addl, clouds_sheet, clouds_views, all_ids = get_included_revision_ids(doc, sh, only_show_issued)

        try:
            sh_num = safe_str(sh.SheetNumber)
        except:
            sh_num = "<unknown>"

        included_param_names = set()
        unmapped_ids = []

        for rid_int in included_ids:
            pname = rev_id_to_param.get(int(rid_int), None)
            if pname:
                included_param_names.add(pname)
            else:
                unmapped_ids.append(int(rid_int))

        sheet_debug.append({
            "SheetNumber": sh_num,
            "IncludedRevisionIds": len(included_ids),
            "UnmappedIncludedRevisionIds": len(unmapped_ids),
            "IncludedParamNames": len(included_param_names),
            "CheckedOnSheetCount": len(addl),
            "CloudsOnSheetCount": len(clouds_sheet),
            "CloudsInViewsCount": len(clouds_views),
            "GetAllRevisionIdsCount": len(all_ids),
        })

        if unmapped_ids:
            if len(missing_map_errors) < 50:
                missing_map_errors.append({
                    "Sheet": sh_num,
                    "UnmappedRevisionIds": unmapped_ids[:20],
                    "RevPrefixUsed": rev_prefix_used,
                })

        if only_add_sheets_with_revs and len(included_param_names) == 0:
            sheets_skipped += 1
            continue

        sheets_processed += 1

        for pname in included_param_names:
            p = get_sheet_param_by_name(sh, pname)
            if p is None:
                if len(missing_param_errors) < 50:
                    missing_param_errors.append({"Sheet": sh_num, "Param": safe_str(pname), "Reason": "LookupParameter returned None"})
                continue

            changed, failed, reason = set_string_param(p, TRUE_SYMBOL)
            if failed:
                if len(write_fail_errors) < 50:
                    write_fail_errors.append({
                        "Sheet": sh_num,
                        "Param": safe_str(pname),
                        "IsReadOnly": bool(getattr(p, "IsReadOnly", False)),
                        "Reason": safe_str(reason),
                    })
                continue
            if changed:
                set_cells += 1

        if (not only_add_sheets_with_revs) and clear_not_included:
            for pname in param_names:
                if pname in included_param_names:
                    continue
                p = get_sheet_param_by_name(sh, pname)
                if p is None:
                    continue
                changed, failed, reason = set_string_param(p, "")
                if failed:
                    if len(write_fail_errors) < 50:
                        write_fail_errors.append({
                            "Sheet": sh_num,
                            "Param": safe_str(pname),
                            "IsReadOnly": bool(getattr(p, "IsReadOnly", False)),
                            "Reason": safe_str(reason),
                        })
                    continue
                if changed:
                    cleared_cells += 1

    try:
        doc.Regenerate()
    except:
        pass

finally:
    try:
        TransactionManager.Instance.TransactionTaskDone()
    except:
        pass

# fail-loud if any operational errors occurred
op_errors = []
if missing_map_errors:
    op_errors.append("Included revisions could not be mapped to parameters (RevIdToParam mismatch).")
if missing_param_errors:
    op_errors.append("Some sheet parameters were missing (LookupParameter returned None).")
if write_fail_errors:
    op_errors.append("Some parameters could not be written (read-only or Set failures).")

if op_errors:
    _fail_loud(
        reason="; ".join(op_errors),
        hint="Binding must exist on sheets; name rule must match; read-only failures must be resolved by re-binding correctly.",
        extract={
            **extract_dbg,
            "SheetsTotal": len(sheets),
            "SheetsProcessed": sheets_processed,
            "SheetsSkipped": sheets_skipped,
            "SetCells": set_cells,
            "ClearedCells": cleared_cells,
        },
        errors=[
            "MissingMapSample={}".format(missing_map_errors[:10]),
            "MissingParamSample={}".format(missing_param_errors[:10]),
            "WriteFailSample={}".format(write_fail_errors[:10]),
        ]
    )

report.update({
    "SheetsTotal": len(sheets),
    "SheetsProcessed": sheets_processed,
    "SheetsSkippedNoRevs": sheets_skipped,
    "SetCells": set_cells,
    "ClearedCells": cleared_cells,
    "MissingMapCount": len(missing_map_errors),
    "MissingParamCount": len(missing_param_errors),
    "WriteFailCount": len(write_fail_errors),
})

debug.update({
    "Extract": extract_dbg,
    "SheetDebugSample": sheet_debug[:50],
})

OUT = {
    "SharedParamFilePath": sp_path,
    "SharedParamGroupName": sp_group_name,
    "ParamGroupAssignment": group_assignment,
    "RevPrefix": rev_prefix_used,
    "ParamNames": [safe_str(x) for x in param_names],
    "RevIdToParam": {safe_str(k): safe_str(v) for k, v in rev_id_to_param.items()},
    "Report": report,
    "Debug": debug,
    "Notes": notes,
}
# ----------------------------------------
watch_4 = Watch(py_revparams_stampsheets_py)
